# Grasshopper definition 24_Center SG_Grid_V.gh (Grasshopper 1.0.8)
# plug-ins: Rhino.Inside for Autodesk Revit

doubleclick = BooleanToggle(False)
dss_annotation_panel = Panel("Help on WhiteWork")
# User Interface: I/O
dss_log_v5_2 = PythonScript(Help=doubleclick)  # inputs Help: Boolean
# ---------- dss_log_v5_2: Python ----------
"""
Set grasshopper template and provide easy acces to Help file in intranet

"""

"""
Credits:
    20211117
    Created by Vladimir Ondejcik
    White arkitekter AB

Based on:
    WOMBAT version <0.0.1>
    Script by <Brian Ringley>
        def libraries() by <Giulio Piacentino> see <http://www.grasshopper3d.com/forum/topics/gh-filename-is-python>
        def writeToFile() by <Data Analytics Society> see <https://www.youtube.com/watch?v=-TF3mXhnCDw>
    Script version <15 September 2015> 
    Copyright <Creative Commons Sharealike>
"""


#add dsearch default path located on cad.local
import sys
new_path = r"\\sesthfs02\DSEARCH\REPOSITORY\Grasshopper\Xtras\DsearchCode"
if new_path not in sys.path: sys.path.append(new_path)

#import dsearch plugin
import dsearch as ds

import os

print sys.path

#reload module (this has use when working on module)
#reload(ds.DS_Log)
#reload(ds.DS_Links)

#setup template
template=ds.DS_Links.Template
ds.DS_Log.DS_Template(template)

#run help from module 
if Help:
    helpLink=ds.DS_Links.HelpLink
    ds.DS_Log.DS_Help(helpLink)

    #turn toggle back to false
    obj=ghenv.Component.Params.Input[0].Sources[0]
    obj.Value=False
    obj.ExpireSolution(True)
# ---------- end dss_log_v5_2 ----------

dss_projectnumber = Panel("0000")
dss_projectname = Panel("name")

# ----
# Organization of Grasshopper scripts at White:
# Script should be created and annotated always with notion that other person will need to use/edit them.
# Build your script in modules and segments, use color coding and annotation according this template.
# This standard should be applied to all scripts, big or small.
# 
# Read  guide on white work:
# "https://work.white.se/grasshopper-developer-guide/"
# For Advanced users:
# For design scripts running more than a month use "dsInitialize" and "dsScriptLog" functions on Dsearch tab to log changes over time.
dss_annotation_panel_2 = Panel("""Tip of a day:
You can change default colour grups by right clicking
Graphical templates are located on "Dsearch" tab""")
image = ImageSampler(dss_annotation_panel_2, Filter="Colour", Interpolate=False, Umax=1, Umin=0, Vmax=1, Vmin=0, Wrap=0)

# ----
# GRAPHIC
# STANDARD
# data and geometry import from rhino or external platforms
# variable parameters and script execution
# (sliders, boolean togggle, text input,...)
# monitor data and geometry preview (used for panels for example)
# output data to rhino or external platforms
# general annotation and notes
# textbased scripting and special plugins
# f.ex: HumanUI, kangaroo,...
# problematic or under repair or construction
# group modules into larger coherent parts
dss_annotation_panel_3 = Panel("general development modules")

categories = QueryCategories(Type=1, Name="Roofs", IsVisibleUI=True, IsSubcategory=False)
active_selection = GraphicalElement()
catfltr = CategoryFilter(Categories=categories, Inverted=False)
filtelem = FilterElements(Elements=active_selection, Filter=catfltr)
cull = CullPattern(List=active_selection, CullPattern=filtelem)

item = ListItem(List=cull, Index=0, Wrap=True)

active_selection_2 = GraphicalElement(item)

# ---- group: Geoetry Grid
active_selection_3 = GraphicalElement(active_selection_2)
hostgrids = HostCurtainGrids(Host=active_selection_3)
boundprof = HostBoundaryProfile(Host=active_selection_3)  # -> Plane, Profile
deconstruct_curtain_grid = DeconstructCurtainGrid(CurtainGrid=hostgrids)  # -> Cells, Mullions, Panels, VerticalLines, VerticalAngle, VerticalJustification, VerticalOffset, HorizontalLines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
pln = Plane(boundprof.Plane)
line = Line(deconstruct_curtain_grid.VerticalLines)

# ----
item_2 = ListItem(List=line, Index=0, Wrap=True)  # -> Item, Item1
midpt = CurveMiddle(Curve=item_2.Item1)
crv_cp = CurveClosestPoint(Point=midpt, Curve=item_2.Item)  # -> Point, Parameter, Distance
division = Division(A=crv_cp.Distance, B="2")  # -> flatten(Result)
storlek_platta = Panel(division)

explode = Explode(Curve=boundprof.Profile, Recursive=True)  # -> Segments, Vertices
vec = Vector(explode.Segments)

# ---- group: Check Direction
line_2 = Line(line)
# Back-end
item_3 = ListItem(List=line_2, Index=0, Wrap=True)
vec_2 = Vector(unitize(item_3))

# ----
dprod = DotProduct(VectorA=vec_2, VectorB=vec, Unitize=False)
cull_2 = CullPattern(List=explode.Segments, CullPattern=dprod)
line_3 = Line(cull_2)
len = Length(Curve=line_3)
sort = SortList(Keys=len, ValuesA=line_3)  # -> Keys, ValuesA
item_4 = ListItem(List=sort.ValuesA, Index=0, Wrap=True)  # -> Item, Item1
midpt_2 = CurveMiddle(Curve=item_4.Item1)
crv_cp_2 = CurveClosestPoint(Point=midpt_2, Curve=item_4.Item)  # -> Point, Parameter, Distance
vec2pt = Vector2Pt(PointA=crv_cp_2.Point, PointB=midpt_2, Unitize=False)  # -> Vector, Length
division_2 = Division(A=vec2pt.Vector, B="2")
move = Move(Geometry=item_4.Item, Motion=division_2)  # -> Geometry, Transform
crv = Curve(move.Geometry)

# ---- group: Check Direction (continued)
vec_3 = Vector(unitize(crv))
dprod_2 = DotProduct(VectorA=vec_2, VectorB=vec_3, Unitize=False)
bool = Boolean(dprod_2)

# ---- group: Project geometry (Grid lines)
line_4 = Line(deconstruct_curtain_grid.HorizontalLines)
line_5 = Line(deconstruct_curtain_grid.VerticalLines)
bool_2 = Boolean(dprod_2)
pln_2 = Plane(pln)
filter = StreamFilter(Gate=bool_2, Stream0=line_4, Stream1=line_5)
project = Project(Geometry=filter, Plane=pln_2)  # -> Geometry, Transform
line_6 = Line(project.Geometry)

# ---- group: Parameters to adjoust grid - could be different
active_selection_4 = GraphicalElement(active_selection_2)
parameters = QueryElementParameters(Element=active_selection_4)
tmatch = MatchText(Text=parameters, RegEx="Offset", Case=True)
cull_3 = CullPattern(List=parameters, CullPattern=tmatch)
identity = ParameterIdentity(Parameter=cull_3)  # -> Guid, Name, Type, Group
value_picker = ValuePicker(identity.Group)
tmatch_2 = MatchText(Text=identity.Group, RegEx=simplify(graft(value_picker)), Case=True)
cull_4 = CullPattern(List=cull_3, CullPattern=tmatch_2)  # -> flatten(List)
bool_3 = Boolean(invert(dprod_2))
item_5 = ListItem(List=cull_4, Index=0, Wrap=True)  # -> Item, Item1
filter_2 = StreamFilter(Gate=bool_3, Stream0=item_5.Item, Stream1=item_5.Item1)
parameter = Parameter(filter_2)

# ---- group: Referance line
line_7 = Line(deconstruct_curtain_grid.HorizontalLines)
bool_4 = Boolean(invert(bool))
line_8 = Line(deconstruct_curtain_grid.VerticalLines)
filter_3 = StreamFilter(Gate=bool_4, Stream0=line_7, Stream1=line_8)
item_6 = ListItem(List=filter_3, Index=0, Wrap=True)

# ---- group: Calculate movement
line_9 = Line(crv)
midpt_3 = CurveMiddle(Curve=line_9)
line_10 = Line(line_6)
crv_cp_3 = CurveClosestPoint(Point=midpt_3, Curve=line_10)  # -> Point, Parameter, Distance
sort_2 = SortList(Keys=crv_cp_3.Distance, ValuesA=crv_cp_3.Point)  # -> Keys, ValuesA
item_7 = ListItem(List=sort_2.ValuesA, Index=0, Wrap=True)
line_11 = Line(item_6)
ln = Line(StartPoint=midpt_3, EndPoint=item_7)
flip = FlipCurve(Curve=ln, Guide=line_11)  # -> Curve, Flag
len_2 = Length(Curve=ln)
neg = Negative(Value=len_2)
filter_4 = StreamFilter(Gate=flip.Flag, Stream0=neg, Stream1=len_2)

# ----
identity_2 = ParameterIdentity(Parameter=parameter)  # -> Guid, Name, Type, Group

# ---- group: Query current offset value
parameter_2 = Parameter(parameter)
active_selection_5 = GraphicalElement(active_selection_2)
param = ElementParameter(Element=active_selection_5, Parameter=parameter_2)  # -> Element, Value

# ---- group: Offset adjoustment
addition = Addition(A=param.Value, B=filter_4)
num = Number(storlek_platta)
addition_2 = Addition(A=addition, B=num)

# ----
param_2 = ElementParameter(Element=param.Element, Parameter=parameter_2, Value=addition_2)  # -> Element, Value
