# Grasshopper definition 26_Dim_SG_Grid.gh (Grasshopper 1.0.8)
# plug-ins: Rhino.Inside for Autodesk Revit

active_selection = GraphicalElement()
active_selection_2 = GraphicalElement(active_selection)
active_selection_3 = GraphicalElement(active_selection)
hostgrids = HostCurtainGrids(Host=active_selection_2)
hostgrids_2 = HostCurtainGrids(Host=active_selection_3)
e_references = ElementReferences(Element=active_selection_2, Invisble=True)  # -> flatten(Element), simplify(Faces), Edges, Lines
deconstruct_curtain_grid = DeconstructCurtainGrid(CurtainGrid=hostgrids)  # -> Cells, Mullions, Panels, VerticalLines, VerticalAngle, VerticalJustification, VerticalOffset, HorizontalLines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
boundprof = HostBoundaryProfile(Host=active_selection_2)  # -> Plane, Profile
e_references_2 = ElementReferences(Element=active_selection_3, Invisble=True)  # -> flatten(Element), simplify(Faces), Edges, Lines
deconstruct_curtain_grid_2 = DeconstructCurtainGrid(CurtainGrid=hostgrids_2)  # -> Cells, Mullions, Panels, VerticalLines, VerticalAngle, VerticalJustification, VerticalOffset, HorizontalLines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
boundprof_2 = HostBoundaryProfile(Host=active_selection_3)  # -> Plane, Profile
s_lines = SketchLines(Sketch=active_selection_2)  # -> Owner, WorkPlane, ModelLines
s_lines_2 = SketchLines(Sketch=active_selection_3)  # -> Owner, WorkPlane, ModelLines
line = Line(deconstruct_curtain_grid.VerticalLines)
line_2 = Line(deconstruct_curtain_grid_2.HorizontalLines)
line_3 = Line(e_references.Lines)
line_4 = Line(s_lines.ModelLines)
vec = Vector(unitize(line))
line_5 = Line(e_references_2.Lines)
line_6 = Line(s_lines_2.ModelLines)
vec_2 = Vector(unitize(line_2))
vec_3 = Vector(line_3)
cset = CreateSet(List=vec)  # -> Set, Map
vec_4 = Vector(line_5)
vec_5 = Vector(unitize(line_4))
cset_2 = CreateSet(List=vec_2)  # -> Set, Map
vec_6 = Vector(unitize(line_6))
dprod = DotProduct(VectorA=cset.Set, VectorB=vec_3, Unitize=False)
md_slider = MDSlider(SliderMode=0, slider_value=Point(0.5, 0.5, 0.5), x_domain=Domain(0, 1), y_domain=Domain(0, 1), z_domain=Domain(0, 1))
dprod_2 = DotProduct(VectorA=cset.Set, VectorB=vec_5, Unitize=False)
dprod_3 = DotProduct(VectorA=cset_2.Set, VectorB=vec_4, Unitize=False)
md_slider_2 = MDSlider(SliderMode=0, slider_value=Point(0.5, 0.5, 0.5), x_domain=Domain(0, 1), y_domain=Domain(0, 1), z_domain=Domain(0, 1))
dprod_4 = DotProduct(VectorA=cset_2.Set, VectorB=vec_6, Unitize=False)
cull = CullPattern(List=e_references.Lines, CullPattern=dprod)
cull_2 = CullPattern(List=line_4, CullPattern=dprod_2)
cull_3 = CullPattern(List=e_references_2.Lines, CullPattern=dprod_3)
e_references_3 = ElementReferences(Element=deconstruct_curtain_grid.Mullions)  # -> simplify(Faces), Edges, Lines
cull_4 = CullPattern(List=line_6, CullPattern=dprod_4)
e_references_4 = ElementReferences(Element=deconstruct_curtain_grid_2.Mullions)  # -> simplify(Faces), Edges, Lines
line_7 = Line(cull)
evalsrf = EvaluateSurface(Surface=e_references_3.Faces, Point=md_slider)  # -> Point, Normal, UDirection, VDirection, Frame
midpt = CurveMiddle(Curve=cull_2)  # -> simplify(graft(Midpoint))
line_8 = Line(cull_3)
evalsrf_2 = EvaluateSurface(Surface=e_references_4.Faces, Point=md_slider_2)  # -> Point, Normal, UDirection, VDirection, Frame
midpt_2 = CurveMiddle(Curve=cull_4)  # -> simplify(graft(Midpoint))
Z = UnitZ(Factor=1)
Z_2 = UnitZ(Factor=1)
dprod_5 = DotProduct(VectorA=evalsrf.Normal, VectorB=Z, Unitize=False)
dprod_6 = DotProduct(VectorA=evalsrf_2.Normal, VectorB=Z_2, Unitize=False)
cull_5 = CullPattern(List=e_references_3.Faces, CullPattern=invert(dprod_5))
project = Project(Geometry=line_7, Plane=boundprof.Plane)  # -> Geometry, Transform
pln = Plane(active_selection_2)
cull_6 = CullPattern(List=e_references_4.Faces, CullPattern=invert(dprod_6))
project_2 = Project(Geometry=line_8, Plane=boundprof_2.Plane)  # -> Geometry, Transform
pln_2 = Plane(active_selection_3)
crv_cp = CurveClosestPoint(Point=midpt, Curve=project.Geometry)  # -> simplify(Point), Parameter, simplify(Distance)
project_3 = Project(Geometry=midpt, Plane=pln)  # -> Geometry, Transform
crv_cp_2 = CurveClosestPoint(Point=midpt_2, Curve=project_2.Geometry)  # -> simplify(Point), Parameter, simplify(Distance)
project_4 = Project(Geometry=midpt_2, Plane=pln_2)  # -> Geometry, Transform
sort = SortList(Keys=crv_cp.Distance, ValuesA=cull, ValuesB=crv_cp.Point)  # -> Keys, ValuesA, ValuesB
sort_2 = SortList(Keys=crv_cp_2.Distance, ValuesA=cull_3, ValuesB=crv_cp_2.Point)  # -> Keys, ValuesA, ValuesB
srf_cp = SurfaceClosestPoint(Point=project_3.Geometry, Surface=flatten(cull_5))  # -> Point, UVPoint, Distance
cull_7 = CullPattern(List=e_references_3.Faces, CullPattern=invert(dprod_5))
srf_cp_2 = SurfaceClosestPoint(Point=project_4.Geometry, Surface=flatten(cull_6))  # -> Point, UVPoint, Distance
item = ListItem(List=sort.ValuesA, Index=0, Wrap=True)  # -> simplify(Item)
cull_8 = CullPattern(List=e_references_4.Faces, CullPattern=invert(dprod_6))
item_2 = ListItem(List=sort_2.ValuesA, Index=0, Wrap=True)  # -> simplify(Item)
item_3 = ListItem(List=sort.ValuesB, Index=0, Wrap=True)  # -> simplify(Item)
item_4 = ListItem(List=sort_2.ValuesB, Index=0, Wrap=True)  # -> simplify(Item)
sort_3 = SortList(Keys=srf_cp.Distance, ValuesA=flatten(cull_7), ValuesB=srf_cp.Point)  # -> Keys, ValuesA, ValuesB
sort_4 = SortList(Keys=srf_cp_2.Distance, ValuesA=flatten(cull_8), ValuesB=srf_cp_2.Point)  # -> Keys, ValuesA, ValuesB
item_5 = ListItem(List=sort_3.ValuesB, Index=0, Wrap=True)
item_6 = ListItem(List=sort_4.ValuesB, Index=0, Wrap=True)
crv_cp_3 = CurveClosestPoint(Point=item_5, Curve=item)  # -> Point, Parameter, Distance
crv_cp_4 = CurveClosestPoint(Point=item_6, Curve=item_2)  # -> Point, Parameter, Distance
types = QueryTypes(Kind=3, Category=null)
item_7 = ListItem(List=sort_3.ValuesA, Index=0, Wrap=True)
ln = Line(StartPoint=item_5, EndPoint=crv_cp_3.Point)
a_view = ActiveView()
item_8 = ListItem(List=sort_4.ValuesA, Index=0, Wrap=True)
ln_2 = Line(StartPoint=item_6, EndPoint=crv_cp_4.Point)
a_view_2 = ActiveView()
tmatch = MatchText(Text=types, RegEx="Kontroll", Case=True)
cull_9 = CullPattern(List=types, CullPattern=tmatch)
value_picker = ValuePicker(cull_9)
a_dim = AddAlignedDimension(View=a_view, References=[item, item_7], Line=ln, Type=value_picker)
a_dim_2 = AddAlignedDimension(View=a_view_2, References=[item_2, item_8], Line=ln_2, Type=value_picker)
